# Grasshopper definition Ex01_ElasticRod.gh (Grasshopper 1.0.8)
# plug-ins: ErodDataGH Info, ElasticRodGH Info

# ----
# Input model
number_slider = Slider(2, range=0..10)
number_slider_2 = Slider(40, range=0..40)
xz = XZPlane(Origin=Point(0, 0, 0))
arc = Arc(Plane=xz, Radius=number_slider, Angle=Domain(0, 3.141592654))  # -> Arc, Length
divide = DivideCurve(Curve=arc.Arc, Count=number_slider_2, Kinks=False)  # -> Points, Tangents, Parameters
pline = PolyLine(Vertices=divide.Points, Closed=False)

# ----
# External Force
number_slider_3 = Slider(0.8, range=0..10)
pt = ConstructPoint(XCoordinate=0, YCoordinate=number_slider_3, ZCoordinate=number_slider_3)
division = Division(A=number_slider_2, B=2)
int = Integer(division)
vec = Vector(pt)
item = ListItem(List=divide.Points, Index=int, Wrap=True)
force = Force(Point=item, Vector=vec)
vdis = VectorDisplay(Anchor=item, Vector=vec)

# ----
# Support Conditions
toggle = BooleanToggle(True)
item_2 = ListItem(List=divide.Points, Index=0, Wrap=True)  # -> Item1, Item
support = Support(Point=item_2.Item, X=toggle, Y=True, Z=True, IsTemporary=False, ReleaseCoefficient=0.5)
support_2 = Support(Point=item_2.Item1, X=True, Y=True, Z=True, IsTemporary=False, ReleaseCoefficient=0.5)
merge = Merge(Data1=support_2, Data2=support)  # -> flatten(Result)

# ----
# Material
number_slider_4 = Slider(21000, range=0..100000)
materialglobal = MaterialGlobal(
    E=number_slider_4,
    Nu=Slider(0.4, range=0..1),
    Width=Slider(0.2, range=0..1),
    Height=Slider(0.1, range=0..0.1),
    orientation=0)

# ----
# Model Initialization
remove_rest_curvatures = BooleanToggle(False)
rodio = RodIO(Polyline=pline, Supports=merge, Material=materialglobal, IsStraight=remove_rest_curvatures, Forces=force)
elasticrod = ElasticRod(Data=rodio)

run_simulation = BooleanToggle(True)
reset_simulation = Button()

solveropts = SolverOptions(Steps=20, Iterations=20, GradTol=1e-08, IncludeForces=Toggle(True), reportType=0)

# ----
# Equilibrium solver
solverequilibrium = SolverEquilibrium(Model=elasticrod, Opts=solveropts, Run=run_simulation, Reset=reset_simulation)  # -> Model, Report

# ----
# Analysis
memodels = MetricsModels(ElasticModel=solverequilibrium.Model, Alpha=0.3, cmapIdx=0, metricsIdx=0)  # -> Mesh, Data
stresses = Stresses(Model=solverequilibrium.Model)  # -> Nodes, EdgeNodes, Stretching, Twisting, MaxBending, MinBending, SqrtBending, VonMises
stiffnesses = Stiffnesses(Model=solverequilibrium.Model)  # -> Nodes, EdgeNodes, Stretching, Twisting, EIx, EIy

pdecon = Deconstruct(Point=stresses.Nodes)  # -> XComponent, YComponent, ZComponent
line3dplot = Line3DPlot(
    DataX=pdecon.XComponent,
    DataY=pdecon.YComponent,
    DataZ=pdecon.ZComponent,
    DataW=stresses.Twisting,
    LabelX="x",
    LabelY="y",
    LabelZ="z",
    LineWidth=10,
    ShowMarkers=True,
    ShowPlots=Button(),
    colorscaleIdx=5)
histogramplot = HistogramPlot(Data=stresses.Twisting, MaxNumGroups=5, ShowLegend=False, ShowPlots=Button(), functionIdx=0, normalizationIdx=0)
pointdensityplot = PointDensityPlot(
    DataX=stresses.Twisting,
    DataY=stresses.MinBending,
    NumContours=0,
    ShowContours=False,
    ShowPlots=Button(),
    colorscaleIdx=0,
    normalizationIdx=0)
multiplication = Multiplication(A=pdecon.YComponent, B=0.9)
multiplication_2 = Multiplication(A=pdecon.YComponent, B=1.25)
point3dplot = Point3DPlot(
    DataX=pdecon.XComponent,
    DataY=pdecon.YComponent,
    DataZ=pdecon.ZComponent,
    LabelX="x",
    LabelY="y",
    LabelZ="z",
    ShowPlots=Button())
lng = ListLength(List=multiplication_2)
series = Series(Start=0, Step=1, Count=lng)
rangeplot = RangePlot(
    DataX=pdecon.XComponent,
    DataY=pdecon.YComponent,
    UpperY=multiplication_2,
    LowerY=multiplication,
    DataLabels=series,
    ShowPlots=Button())
