# Grasshopper definition Ex02_PeriodicRod.gh (Grasshopper 1.0.8)
# plug-ins: ErodDataGH Info, ElasticRodGH Info

# ----
# Initial Data
number_slider = Slider(10, range=0..10)
cir = Circle(Plane=PlaneXY(0, 0, 0), Radius=number_slider)
divide = DivideCurve(Curve=cir, Count=Slider(40, range=10..40), Kinks=False)  # -> Points, Tangents, Parameters
pline = PolyLine(Vertices=divide.Points, Closed=True)
lng = ListLength(List=divide.Points)
division = Division(A=lng, B="4")
int = Integer(division)
series = Series(Start=0, Step=int, Count="4")

# ----
# External Forces
number_slider_2 = Slider(0.4, range=0..1)
item = ListItem(List=divide.Points, Index=series, Wrap=True)
item_2 = ListItem(List=item, Index=[0, 2], Wrap=True)
Z = UnitZ(Factor=number_slider_2)
force = Force(Point=item_2, Vector=Z)

# ----
# Material
number_slider_3 = Slider(21000, range=0..100000)
number_slider_4 = Slider(0.3, range=0..1)
materialglobal = MaterialGlobal(E=number_slider_3, Nu=Slider(0.5, range=0..1), Width=number_slider_4, Height=number_slider_4, orientation=0)

# ----
# Support Conditions
item_3 = ListItem(List=series, Index=[1, 3], Wrap=True)
item_4 = ListItem(List=divide.Points, Index=item_3, Wrap=True)
support = Support(Point=item_4, X=True, Y=True, Z=True, XX=True, YY=True, ZZ=True, IsTemporary=False, ReleaseCoefficient=0.5)

# ----
# Model Initialization
rodio = RodIO(Polyline=pline, Supports=support, Material=materialglobal, IsStraight=True, Forces=force)
# Solver
elasticrod = ElasticRod(Data=rodio)

solveropts = SolverOptions(Steps=20, Iterations=20, GradTol=1e-08, IncludeForces=Toggle(True), reportType=0)
equilibriumsolver = EquilibriumSolver(ElasticModel=elasticrod, Opts=solveropts, Run=Toggle(False), Reset=Button())  # -> ElasticModel, Report

# ----
# Analysis
memodels = MetricsModels(ElasticModel=equilibriumsolver.ElasticModel, Alpha=0.3, ShowPlots=False, cmapIdx=0, metricsIdx=4)  # -> Mesh, Data
energies = Energies(Model=equilibriumsolver.ElasticModel)  # -> Total, Bending, Stretching, Twisting, Strain
panel = Panel(energies.Total)
panel_2 = Panel(energies.Bending)
panel_3 = Panel(energies.Stretching)
panel_4 = Panel(energies.Twisting)
panel_5 = Panel(energies.Strain)
