# Grasshopper definition Ex02_PeriodicRod.gh (Grasshopper 1.0.7)
# plug-ins: ElasticRodGH Info

# ----
# Initial Data
number_slider = Slider(10, range=0..10)
cir = Circle(Plane=PlaneXY(0, 0, 0), Radius=number_slider)
divide = DivideCurve(Curve=cir, Count=Slider(40, range=10..40), Kinks=False)  # -> Points, Tangents, Parameters
pline = PolyLine(Vertices=divide.Points, Closed=True)
lng = ListLength(List=divide.Points)
division = Division(A=lng, B="4")
int = Integer(division)
series = Series(Start=0, Step=int, Count="4")

# ----
# External Forces
number_slider_2 = Slider(5, range=0..10)
item = ListItem(List=divide.Points, Index=series, Wrap=True)
item_2 = ListItem(List=item, Index=[0, 2], Wrap=True)
Z = UnitZ(Factor=number_slider_2)
force = Force(Point=item_2, Vector=Z)
vdis = VectorDisplay(Anchor=item_2, Vector=Z)

# ----
# Support Conditions
item_3 = ListItem(List=series, Index=[1, 3], Wrap=True)
item_4 = ListItem(List=divide.Points, Index=item_3, Wrap=True)
support = Support(Point=item_4, X=True, Y=True, Z=True, XX=True, YY=True, ZZ=True)
sph = Sphere(Base=item_4, Radius=1)

# ----
# Material
number_slider_3 = Slider(0.3, range=0..1)
materialglobal = MaterialGlobal(
    E=Slider(21000, range=0..100000),
    Nu=Slider(0.5, range=0..1),
    Width=number_slider_3,
    Height=number_slider_3,
    orientation=0,
    section=1)

# ----
# Model Initialization
elasticroddata = ElasticRodData(Polyline=pline, Supports=support, Forces=force, Materials=materialglobal)  # -> Data, Vertices, Indexes
elasticrod = ElasticRod(Data=elasticroddata.Data)

# ----
# Solver
toggle = BooleanToggle(False)
solver = Solver(Model=elasticrod, Threshold=1e-06, Run=toggle, Reset=Button(), graphics=0)

# ----
# Analysis
deelasticrod = DeconstructElasticRod(Model=solver)  # -> CenterLine, Nodes, RestLengths, Stretching, Twisting, MaxBend, MinBend, SqrtBend
bnd = Bounds(Numbers=deelasticrod.SqrtBend)
dedomain = DeconstructDomain(Domain=bnd)  # -> Start, End
gradient = Gradient(
    LowerLimit=dedomain.Start,
    UpperLimit=dedomain.End,
    Parameter=deelasticrod.SqrtBend,
    stops=[0: RGB(0, 128, 0), 0.5: RGB(255, 255, 0), 1: RGB(255, 0, 0)])
mesh = Mesh(solver)
mspray = MeshSpray(Mesh=mesh, Points=deelasticrod.Nodes, Colours=gradient, SprayMode=11)
tag = TextTag(Location=deelasticrod.Nodes, Text=deelasticrod.SqrtBend, Colour=ColourSwatch(SwatchColor=RGB(0, 0, 0)))
